# Grasshopper definition 0114_truchetBasicImg.gh (Grasshopper 1.0.7)
# plug-ins: Clipper, Bifocals

sqgrid = Square(Plane=PlaneXY(0, 0, 0), Size=Slider(10, range=3..20), ExtentX=Slider(60, range=0..100), ExtentY=Slider(80, range=0..100))  # -> simplify(Cells), Points
panel = Panel("""0.5
1
1.5""")
explode = Explode(Curve=sqgrid.Cells, Recursive=True)  # -> Segments, simplify(Vertices)
pi = Pi(Factor=panel)
item = ListItem(List=pi, Index=0, Wrap=True)  # -> Item, Item1, Item2
item_2 = ListItem(List=explode.Vertices, Index=0, Wrap=True)  # -> Item, Item1, Item2

# ---- group: imgControlPattern
area = Area(Geometry=sqgrid.Cells)  # -> Area, Centroid
cullpt = CullDuplicates(Points=flatten(area.Centroid), Tolerance=0.1, CullMode=1)  # -> Points, Indices, Valence
image = ImageSampler(
    cullpt.Points,
    FilePath="D:\Work\WS_2020_YunTech_Fab\ref\2D_Pattern\images.jpg",
    Filter="Value",
    Interpolate=True,
    Umax=600,
    Umin=0,
    Vmax=800,
    Vmin=0,
    Wrap=1)
bnd = Bounds(Numbers=image)
remap = RemapNumbers(Value=image, Source=bnd, Target=Slider(4, range=0..10))  # -> Mapped, Clipped
graph = GraphMapper(remap.Mapped, x0=0, x1=3, y0=0, y1=3, container_name="Bezier", cpx=[0, 1, 0.1598024219, 1], cpy=[0, 0, 0.7194740176, 1])
round = Round(Number=graph)  # -> Nearest, Floor, Ceiling

# ----
blrt = Line(StartPoint=item_2.Item, EndPoint=item_2.Item2)
area_2 = Area(Geometry=graft(sqgrid.Cells))  # -> Area, Centroid

crv = Curve([<curve referenced from the Rhino model> x4])
group = Group(Objects=crv)
bbox = BoundingBox(Content=crv, Plane=PlaneXY(0, 0, 0), UnionBox=True)  # -> Box, Box_2
recmap = RectangleMapping(Geometry=group, Source=bbox.Box, Target=sqgrid.Cells)  # -> Geometry, Transform
area_3 = Area(Geometry=sqgrid.Cells)  # -> Area, Centroid
rotate = Rotate(Geometry=recmap.Geometry, Angle=item.Item, Plane=area_3.Centroid)  # -> Geometry, Transform
rotate_2 = Rotate(Geometry=recmap.Geometry, Angle=item.Item1, Plane=area_3.Centroid)  # -> Geometry, Transform
rotate_3 = Rotate(Geometry=recmap.Geometry, Angle=item.Item2, Plane=area_3.Centroid)  # -> Geometry, Transform

group_2 = Group(Objects=blrt)

crv_2 = Curve([<curve referenced from the Rhino model> x4])
group_3 = Group(Objects=crv_2)
bbox_2 = BoundingBox(Content=crv_2, Plane=PlaneXY(0, 0, 0), UnionBox=True)  # -> Box, Box_2
recmap_2 = RectangleMapping(Geometry=group_3, Source=bbox_2.Box, Target=sqgrid.Cells)  # -> Geometry, Transform
area_4 = Area(Geometry=sqgrid.Cells)  # -> Area, Centroid
rotate_4 = Rotate(Geometry=recmap_2.Geometry, Angle=item.Item, Plane=area_4.Centroid)  # -> Geometry, Transform
rotate_5 = Rotate(Geometry=recmap_2.Geometry, Angle=item.Item1, Plane=area_4.Centroid)  # -> Geometry, Transform
rotate_6 = Rotate(Geometry=recmap_2.Geometry, Angle=item.Item2, Plane=area_4.Centroid)  # -> Geometry, Transform

crv_3 = Curve([<curve referenced from the Rhino model> x4])
group_4 = Group(Objects=crv_3)
bbox_3 = BoundingBox(Content=crv_3, Plane=PlaneXY(0, 0, 0), UnionBox=True)  # -> Box, Box_2
recmap_3 = RectangleMapping(Geometry=group_4, Source=bbox_3.Box, Target=sqgrid.Cells)  # -> Geometry, Transform

crv_4 = Curve([<curve referenced from the Rhino model> x4])
group_5 = Group(Objects=crv_4)
bbox_4 = BoundingBox(Content=crv_4, Plane=PlaneXY(0, 0, 0), UnionBox=True)  # -> Box, Box_2
recmap_4 = RectangleMapping(Geometry=group_5, Source=bbox_4.Box, Target=sqgrid.Cells)  # -> Geometry, Transform
area_5 = Area(Geometry=sqgrid.Cells)  # -> Area, Centroid
rotate_7 = Rotate(Geometry=recmap_4.Geometry, Angle=item.Item, Plane=area_5.Centroid)  # -> Geometry, Transform
rotate_8 = Rotate(Geometry=recmap_4.Geometry, Angle=item.Item1, Plane=area_5.Centroid)  # -> Geometry, Transform
rotate_9 = Rotate(Geometry=recmap_4.Geometry, Angle=item.Item2, Plane=area_5.Centroid)  # -> Geometry, Transform

rotate_10 = Rotate(Geometry=group_2, Angle=1.570796327, Plane=area_2.Centroid)  # -> Geometry, Transform
scale = Scale(Geometry=group_2, Center=area_2.Centroid, Factor=0.5)  # -> Geometry, Transform
rotate_11 = Rotate(Geometry=scale.Geometry, Angle=1.570796327, Plane=area_2.Centroid)  # -> Geometry, Transform
p_n_c = PickNChoose(
    Pattern=round.Nearest,
    Stream0=flatten(group_2),
    Stream1=flatten(rotate_10.Geometry),
    Stream2=flatten(scale.Geometry),
    Stream3=flatten(rotate_11.Geometry))
p_n_c_2 = PickNChoose(
    Pattern=round.Nearest,
    Stream0=flatten(rotate_4.Geometry),
    Stream1=flatten(rotate_7.Geometry),
    Stream2=flatten(rotate_2.Geometry),
    Stream3=flatten(recmap_3.Geometry))
ungroup = Ungroup(Group=p_n_c_2)
curvepoint = PointOnCurve(ungroup, parameter=0.5)
image_2 = ImageSampler(
    curvepoint,
    FilePath="D:\Work\WS_2020_YunTech_Fab\ref\2D_Pattern\images.jpg",
    Filter="Colour",
    Interpolate=True,
    Umax=600,
    Umin=0,
    Vmax=800,
    Vmin=0,
    Wrap=1)
crv_5 = Curve([<curve referenced from the Rhino model> x4])  # disabled
preview = CustomPreview(Geometry=ungroup, Material=image_2)
series = Series(Start=0, Step=Slider(1.3, range=0..10), Count=Slider(12, range=5..20))
polyoffset = PolylineOffset(
    Polylines=graft(crv_5),
    Distance=series,
    Plane=Plane(origin=(0, 0, 0), x=(0, 0, 0), y=(0, 0, 0)),
    Tolerance=0.001,
    ClosedFillet=1,
    OpenFillet=1,
    Miter=2)  # -> Contour, simplify(Holes)
pshift = ShiftPaths(Data=polyoffset.Holes, Offset=-1)
curvepoint_2 = PointOnCurve(pshift, parameter=0.5)
incurve = PointInCurve(Point=curvepoint_2, Curve=simplify(graft(crv_5)))  # -> Relationship, Point
equals = Equality(FirstNumber=incurve.Relationship, SecondNumber=0)  # -> Equality, Inequality
cull = CullPattern(List=pshift, CullPattern=equals.Inequality)
