# Grasshopper definition 0115_kMesh.gh (Grasshopper 1.0.7)
# plug-ins: Bifocals, Weaverbird, Kangaroo2 Components, Leopard version 0a1

mesh = Mesh(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)
mesh_2 = Mesh(<mesh referenced from the Rhino model>)
clean = CombineClean(Meshes=mesh)
refine = Refine(Mesh=clean, Level=Slider(3, range=1..5))
medges = MeshEdges(Mesh=refine)  # -> NakedEdges, InteriorEdges, NonManifoldEdges
bbox = BoundingBox(Content=refine, Plane=PlaneXY(0, 0, 0), UnionBox=True)  # -> Box, Box_2
join = JoinCurves(Curves=medges.NakedEdges, Preserve=False)
volume = Volume(Geometry=bbox.Box)  # -> Volume, Centroid
nv = NakedVertices(Mesh=refine)  # -> ClothedIndex, NakedIndex, ClothedPts, NakedPts
explode = Explode(Curve=join, Recursive=True)  # -> Segments, Vertices
number_slider = Slider(0.6, range=0..10)
cullpt = CullDuplicates(Points=explode.Vertices, Tolerance=0.1, CullMode=1)  # -> Points, Indices, Valence
pdecon = Deconstruct(Point=nv.NakedPts)  # -> XComponent, YComponent, ZComponent
vec2pt = Vector2Pt(PointA=volume.Centroid, PointB=cullpt.Points, Unitize=invert(False))  # -> Vector, Length
avr = Average(Input=pdecon.YComponent)
l_selvertices = LeopardsSelectMeshVertices(
    Mesh=refine,
    lock=True,
    maintain=False,
    order=False,
    selectedobject="98|96|94|92|90|88|86|84|82|80|79|78|71|70|69|62|61|60|53|52|51|44|43|42|35|34|33|26|25|24|17|16|15|8|7|6|116|114|112|110|108|106|104|102|100|701|700|699|692|691|690|683|682|681|674|673|672|665|664|663|656|655|654|647|646|645|638|637|636|629|628|627|620|618|616|614|612|610|608|606|604")  # -> Geometry, Index
amp = Amplitude(Vector=vec2pt.Vector, Amplitude=Slider(20, range=0..100))
smaller = SmallerThan(FirstNumber=pdecon.YComponent, SecondNumber=avr)  # -> SmallerThan, OrEqualTo
pt = Point(nv.NakedPts)
move = Move(Geometry=cullpt.Points, Motion=amp)  # -> Geometry, Transform
number_slider_2 = Slider(2, range=0..10)
dispatch = Dispatch(List=nv.NakedPts, DispatchPattern=smaller.SmallerThan)  # -> ListA, ListB
pline = PolyLine(Vertices=move.Geometry, Closed=invert(False))
wbvertices = WeaverbirdsVerticesComponent(MeshClosedPolylinesGroup=refine, Weld=True)
entwine = Entwine(Branch00=dispatch.ListA, Branch01=dispatch.ListB, FlattenInputs=True)  # -> simplify(Result)
smoothpline = SmoothPolyline(Polyline=pline, Strength=1, Times=Slider(15, range=0..20))
crv = Curve(simplify(<curve referenced from the Rhino model>))
edgelengths = EdgeLengths(Mesh=refine, LengthFactor=Slider(1, range=0..1), Strength=1)
anchor = Anchor(Point=l_selvertices.Geometry, Strength=10000)
oncurve = OnCurve(Points=entwine, Curve=smoothpline, Strength=Slider(100, range=0..100))  # disabled
show = Show(G=refine)
load = Load(Point=wbvertices, ForceVector=Vector(0, 0, 1), Weighting=1)
entwine_2 = Entwine(Branch00=show, Branch01=edgelengths, Branch02=anchor, FlattenInputs=True)
solver = Solver(GoalObjects=entwine_2, Reset=Button(), Threshold=1e-15, Tolerance=0.01, On=Toggle(True))  # -> I, V, O
bang = ExplodeTree(Data=solver.O)  # -> Branch0, Branch1, Branch2
mesh_3 = Mesh(bang.Branch0)
