# Grasshopper definition 0115_kMeshCatenary.gh (Grasshopper 1.0.7)
# plug-ins: Bifocals, Weaverbird, Kangaroo2 Components, Leopard version 0a1

mesh = Mesh(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)
mesh_2 = Mesh(<mesh referenced from the Rhino model>)
mesh_3 = Mesh(<mesh referenced from the Rhino model>)
clean = CombineClean(Meshes=mesh_3)
refine = Refine(Mesh=clean, Level=Slider(3, range=1..5))
medges = MeshEdges(Mesh=refine)  # -> NakedEdges, InteriorEdges, NonManifoldEdges
bbox = BoundingBox(Content=refine, Plane=PlaneXY(0, 0, 0), UnionBox=True)  # -> Box, Box_2
join = JoinCurves(Curves=medges.NakedEdges, Preserve=False)
volume = Volume(Geometry=bbox.Box)  # -> Volume, Centroid
nv = NakedVertices(Mesh=refine)  # -> ClothedIndex, NakedIndex, ClothedPts, NakedPts
explode = Explode(Curve=join, Recursive=True)  # -> Segments, Vertices
cullpt = CullDuplicates(Points=explode.Vertices, Tolerance=0.1, CullMode=1)  # -> Points, Indices, Valence
pdecon = Deconstruct(Point=nv.NakedPts)  # -> XComponent, YComponent, ZComponent
vec2pt = Vector2Pt(PointA=volume.Centroid, PointB=cullpt.Points, Unitize=invert(False))  # -> Vector, Length
avr = Average(Input=pdecon.YComponent)
amp = Amplitude(Vector=vec2pt.Vector, Amplitude=Slider(20, range=0..100))
smaller = SmallerThan(FirstNumber=pdecon.YComponent, SecondNumber=avr)  # -> SmallerThan, OrEqualTo
move = Move(Geometry=cullpt.Points, Motion=amp)  # -> Geometry, Transform
dispatch = Dispatch(List=nv.NakedPts, DispatchPattern=smaller.SmallerThan)  # -> ListA, ListB
pline = PolyLine(Vertices=move.Geometry, Closed=invert(False))
l_selvertices = LeopardsSelectMeshVertices(
    Mesh=refine,
    lock=True,
    maintain=False,
    order=False,
    selectedobject="575|573|571|569|567|565|563|561|559|17|15|13|11|9|7|5|3|1")  # -> Geometry, Index
entwine = Entwine(Branch00=dispatch.ListA, Branch01=dispatch.ListB, FlattenInputs=True)  # -> simplify(Result)
crv = Curve(simplify(<curve referenced from the Rhino model>))
smoothpline = SmoothPolyline(Polyline=pline, Strength=1, Times=Slider(15, range=0..20))
wbvertices = WeaverbirdsVerticesComponent(MeshClosedPolylinesGroup=refine, Weld=True)
edgelengths = EdgeLengths(Mesh=refine, LengthFactor=Slider(0.7, range=0..1), Strength=Slider(10, range=0..10))
anchor = Anchor(Point=l_selvertices.Geometry, Strength=10000)
oncurve = OnCurve(Points=entwine, Curve=smoothpline, Strength=Slider(100, range=0..100))  # disabled
load = Load(Point=wbvertices, ForceVector=Vector(0, 0, 1), Weighting=Slider(0.1, range=0.01..0.1))
show = Show(G=refine)
entwine_2 = Entwine(Branch00=show, Branch01=edgelengths, Branch02=anchor, Branch03=load, Branch04=oncurve, FlattenInputs=True)
solver = Solver(GoalObjects=entwine_2, Reset=Button(), Threshold=1e-15, Tolerance=0.01, On=Toggle(True))  # -> I, V, O
bang = ExplodeTree(Data=solver.O)  # -> Branch0, Branch1, Branch2
mesh_4 = Mesh(bang.Branch0)
