# Grasshopper definition 20200117=承恩君恆Upload.gh (Grasshopper 1.0.7)
# plug-ins: MeshEdit Components, Human, Weaverbird, Kangaroo2 Components

mesh = Mesh([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])
clean = CombineClean(Meshes=mesh)
refine = Refine(Mesh=clean, Level=Slider(1, range=1..5))
medges = MeshEdges(Mesh=refine)  # -> NakedEdges, InteriorEdges, NonManifoldEdges
bbox = BoundingBox(Content=refine, Plane=PlaneXY(0, 0, 0), UnionBox=True)  # -> Box, Box_2
nv = NakedVertices(Mesh=refine)  # -> ClothedIndex, NakedIndex, ClothedPts, NakedPts
join = JoinCurves(Curves=medges.NakedEdges, Preserve=False)
volume = Volume(Geometry=bbox.Box)  # -> Volume, Centroid
explode = Explode(Curve=join, Recursive=True)  # -> Segments, Vertices
pdecon = Deconstruct(Point=nv.NakedPts)  # -> XComponent, YComponent, ZComponent
cullpt = CullDuplicates(Points=explode.Vertices, Tolerance=0.1, CullMode=1)  # -> Points, Indices, Valence
vec2pt = Vector2Pt(PointA=volume.Centroid, PointB=cullpt.Points, Unitize=invert(False))  # -> Vector, Length
avr = Average(Input=pdecon.YComponent)
smaller = SmallerThan(FirstNumber=pdecon.YComponent, SecondNumber=avr)  # -> SmallerThan, OrEqualTo
amp = Amplitude(Vector=vec2pt.Vector, Amplitude=Slider(24, range=0..100))
move = Move(Geometry=cullpt.Points, Motion=amp)  # -> Geometry, Transform
dispatch = Dispatch(List=nv.NakedPts, DispatchPattern=smaller.SmallerThan)  # -> ListA, ListB
pline = PolyLine(Vertices=move.Geometry, Closed=invert(False))
number_slider = Slider(100, range=0..100)
number_slider_2 = Slider(2, range=0..20)
entwine = Entwine(Branch00=dispatch.ListA, Branch01=dispatch.ListB, FlattenInputs=True)  # -> simplify(Result)
anchor = Anchor(Point=nv.NakedPts, Strength=10000)
smoothpline = SmoothPolyline(Polyline=pline, Strength=1, Times=Slider(20, range=0..20))
point = Point(entwine)
show = Show(G=refine)
edgelengths = EdgeLengths(Mesh=refine, LengthFactor=Slider(0, range=0..1), Strength=1)
oncurve = OnCurve(Points=nv.NakedPts, Curve=smoothpline, Strength=number_slider)
spherecollide = SphereCollide(Points=nv.NakedPts, Radius=number_slider_2, Strength=number_slider)
entwine_2 = Entwine(Branch00=show, Branch01=oncurve, Branch02=edgelengths, FlattenInputs=True)
solver = Solver(GoalObjects=entwine_2, Reset=Button(), Threshold=1e-15, Tolerance=0.01, On=Toggle(False))  # -> I, V, O
mesh_sphere = MeshSphere(Base=solver.V, Radius=number_slider_2, UCount=10, VCount=20)
bang = ExplodeTree(Data=solver.O)  # -> Branch0, Branch1, Branch2
mesh_2 = Mesh(bang.Branch0)

# ----
# 找最大的邊
# 限制在 60 以內
# 其他邊等比例縮放
limit = Slider(60, range=0..100)

bbox_2 = BoundingBox(Content=mesh_2, Plane=PlaneXY(0, 0, 0))  # -> Box, Box_2
boxprop = BoxProperties(Box=bbox_2.Box)  # -> Center, Diagonal, Area, Volume, Degeneracy
pdecon_2 = Deconstruct(Point=boxprop.Diagonal)  # -> XComponent, YComponent, ZComponent
max = Maximum(A=pdecon_2.XComponent, B=pdecon_2.YComponent)
max_2 = Maximum(A=max, B=pdecon_2.ZComponent)
division = Division(A=limit, B=max_2)

panel = Panel(boxprop.Diagonal)
scale = Scale(Geometry=mesh_2, Center=boxprop.Center, Factor=division)  # -> Geometry, Transform
dam = DataDam(DataA=scale.Geometry, BufferDelay=10000000, BufferMode=0)
material = CreateMaterial(
    Diffuse=RGB(255, 105, 180),
    Specular=RGB(255, 255, 255),
    Emission=RGB(0, 0, 0),
    Transparency=Slider(0.7, range=0..1),
    Shine=0)
preview = CustomPreview(Geometry=dam, Material=material)
stripper = Stripper(Mesh=dam)
unroller = Unroller(Strip=stripper, Unroll=Slider(1, range=0..1))

explode_2 = MeshExplode(Mesh=stripper, Interpolate=False)  # -> simplify(Faces)
tstat = TreeStatistics(Tree=explode_2)  # -> Paths, Length, Count
item = ListItem(List=explode_2, Index=0, Wrap=True)  # -> Item1, Item
series = Series(Start=0, Step=1, Count=tstat.Count)  # -> simplify(graft(Series))
facen = FaceNormals(Mesh=item.Item)  # -> Centers, Normals
gradient = Gradient(
    LowerLimit=0,
    UpperLimit=tstat.Count,
    Parameter=series,
    stops=[0.108: RGB(255, 0, 255), 0.535: RGB(255, 255, 0), 0.945: RGB(0, 255, 255)])
tag = TextTag3D(Location=facen.Centers, Text=series, Size=Slider(1.5, range=0..10), Colour=gradient, Justification=7)

wbnaked = WeaverbirdsNakedBoundary(MeshClosedPolylines=stripper)
wbnaked_2 = WeaverbirdsNakedBoundary(MeshClosedPolylines=dam)
cluster = Cluster(B=Slider(1.7, range=0..10), mesh=unroller)

explode_3 = MeshExplode(Mesh=cluster, Interpolate=False)  # -> simplify(Faces)
item_2 = ListItem(List=explode_3, Index=0, Wrap=True)  # -> Item1, Item
facen_2 = FaceNormals(Mesh=item_2.Item)  # -> Centers, Normals
tag_2 = TextTag(Location=facen_2.Centers, Text=series, Colour=gradient)

explode_4 = Explode(Curve=wbnaked, Recursive=True)  # -> simplify(Segments), Vertices
curvepoint = PointOnCurve(explode_4.Segments, parameter=0.5)
wbnaked_3 = WeaverbirdsNakedBoundary(MeshClosedPolylines=cluster)
explode_5 = Explode(Curve=wbnaked_3, Recursive=True)  # -> simplify(Segments), Vertices
colom = CollisionOneMany(Collider=curvepoint, Obstacles=wbnaked_2)  # -> Collision, Index
dispatch_2 = Dispatch(List=explode_5.Segments, DispatchPattern=invert(colom.Collision))  # -> ListA, ListB
cull = CullPattern(List=explode_4.Segments, CullPattern=invert(colom.Collision))

# ---- group: TabCrv
crv = Curve(graft([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]))
crv_2 = Curve(graft([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]))

# ----
concat = Concatenate(FragmentA="s_", FragmentB=series)
createatts = CreateAttributes(Name=concat, enableFullPath=True)
bake = BakeGeometry(Bake=Button(), Geometry=graft(stripper), Attributes=createatts, DeleteOldBakes=False, PreserveTrees=False)

bbox_3 = BoundingBox(Content=wbnaked_3, Plane=PlaneXY(0, 0, 0))  # -> Box, Box_2
crv_3 = Curve(graft([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]))
wires = BrepWireframe(Brep=bbox_3.Box, Density=-1)
crv_4 = Curve(dispatch_2.ListA)
bbox_4 = BoundingBox(Content=crv_3, Plane=PlaneXY(0, 0, 0))  # -> Box, Box_2
linedim = LineDimension(Line=wires, Text="{0:0.00}", Size=Slider(2, range=0..10))
debox = DeconstructBox(Box=bbox_4.Box)  # -> Plane, X, Y, Z
numstab = Slider(1, range=1..4)
dedomain = DeconstructDomain(Domain=debox.X)  # -> Start, End
subtraction = Subtraction(A=dedomain.End, B=dedomain.Start)
series_2 = Series(Start=0, Step=subtraction, Count=numstab)
X = UnitX(Factor=series_2)
move_2 = Move(Geometry=simplify(crv_3), Motion=simplify(X))  # -> Geometry, Transform
join_2 = JoinCurves(Curves=move_2.Geometry, Preserve=False)  # -> simplify(Curves)
end = EndPoints(Curve=join_2)  # -> Start, End
depthtab = Slider(1, range=0.1..1)
dist = Distance(PointA=end.Start, PointB=end.End)
entwine_3 = Entwine(Branch00=crv_4, Branch01=crv_4, FlattenInputs=True)  # -> simplify(Result)
multiplication = Multiplication(A=dist, B=depthtab)
len = Length(Curve=entwine_3)  # -> simplify(Length)
curvepoint_2 = PointOnCurve(crv_4, parameter=0.5)
division_2 = Division(A=len, B=multiplication)
points = PointList(Points=curvepoint_2, Size=Slider(1.2, range=0..10))
scale_nu = ScaleNU(Geometry=join_2, Plane=PlaneXY(0, 0, 0), ScaleX=division_2, ScaleY=1, ScaleZ=1)  # -> Geometry, Transform
order = PointOrder(Points=curvepoint_2)
bang_2 = ExplodeTree(Data=scale_nu.Geometry)  # -> Branch0, Branch1
unflatten = UnflattenTree(Tree=bang_2.Branch1, Guide=crv_4)  # -> simplify(Tree)
unflatten_2 = UnflattenTree(Tree=bang_2.Branch0, Guide=crv_4)  # -> simplify(Tree)
end_2 = EndPoints(Curve=crv_4)  # -> Start, End
end_3 = EndPoints(Curve=unflatten_2)  # -> Start, End
end_4 = EndPoints(Curve=unflatten)  # -> Start, End
end_5 = EndPoints(Curve=crv_4)  # -> Start, End

# ---- group: label of 2d stripe
mesh_3 = Mesh(flatten(cluster))
explode_6 = MeshExplode(Mesh=mesh_3, Interpolate=False)  # -> simplify(Faces)
lng = ListLength(List=mesh_3)
series_3 = Series(Start=0, Step=1, Count=lng)  # -> graft(Series)
repeat = RepeatData(Data="s_", Length=lng)  # -> graft(Data)
item_3 = ListItem(List=explode_6, Index=0, Wrap=True)  # -> Item1, Item
join_3 = TextJoin(Text=[repeat, series_3])

# ----
vec2pt_2 = Vector2Pt(PointA=end_3.Start, PointB=end_3.End, Unitize=False)  # -> Vector, Length
vec2pt_3 = Vector2Pt(PointA=end_2.Start, PointB=end_2.End, Unitize=False)  # -> Vector, Length
vec2pt_4 = Vector2Pt(PointA=end_4.Start, PointB=end_4.End, Unitize=False)  # -> Vector, Length
vec2pt_5 = Vector2Pt(PointA=end_5.End, PointB=end_5.Start, Unitize=False)  # -> Vector, Length
offset = OffsetCurve(Curve=crv_4, Distance=expr("-(x/2)", depthtab), Plane=PlaneXY(0, 0, 0), Corners=1)
orient = OrientDirection(Geometry=unflatten, PointA=end_4.Start, DirectionA=vec2pt_4.Vector, PointB=end_5.End, DirectionB=vec2pt_5.Vector)  # -> Geometry, Transform
orient_2 = OrientDirection(Geometry=unflatten_2, PointA=end_3.Start, DirectionA=vec2pt_2.Vector, PointB=end_2.Start, DirectionB=vec2pt_3.Vector)  # -> Geometry, Transform
dispatch_3 = Dispatch(List=orient.Geometry, DispatchPattern=[True, False])  # -> ListA, ListB
dispatch_4 = Dispatch(List=orient_2.Geometry, DispatchPattern=[True, False])  # -> ListA, ListB
eval = EvaluateCurve(Curve=reparameterize(offset), Parameter="0.5")  # -> simplify(Point), Tangent, Angle
weave = Weave(Pattern=[0, 1], Stream0=dispatch_4.ListA, Stream1=dispatch_3.ListB, NullGaps=False)  # -> simplify(Weave)
bbox_5 = BoundingBox(Content=item_3.Item, Plane=PlaneXY(0, 0, 0))  # -> Box, Box_2
geo = Geometry(dispatch_4.ListA)
geo_2 = Geometry(dispatch_3.ListA)
join_4 = JoinCurves(Curves=weave, Preserve=False)
cir = Circle(Plane=eval.Point, Radius="0.25")
box = EvaluateBox(Box=bbox_5.Box, UParameter=0.5, VParameter=0.5, WParameter=0.5)  # -> Plane, Point, Include
# Bake!!!!
merge = Merge(Data1=simplify(join_4), Data2=simplify(dispatch_2.ListB))
tag_3 = TextTag(Location=box.Point, Text=join_3)
pshift = ShiftPaths(Data=cir, Offset=-1)
crease = Curve(simplify(crv_4))
cut = Curve(merge)
preview_2 = CustomPreview(Geometry=crease, Material=ColourSwatch(SwatchColor=RGB(0, 0, 0)))
preview_3 = CustomPreview(
    Geometry=cut,
    Material={diffuse=RGB(221, 160, 221), emission=RGB(66, 48, 66), shine=0.5, specular=RGB(255, 255, 255), transparency=0})

# ==== cluster Cluster

# ---- group: Cluster Input
mesh = ClusterInput()

# ----
mesh_2 = Mesh(graft(mesh))
B = ClusterInput()

# ---- group: laying out
explode = MeshExplode(Mesh=mesh_2, Interpolate=False)
item = ListItem(List=explode, Index=0, Wrap=True)
item_2 = ListItem(List=explode, Index=-1, Wrap=True)
facen = FaceNormals(Mesh=item)  # -> Centers, Normals
facen_2 = FaceNormals(Mesh=item_2)  # -> Centers, Normals
pl = PlaneNormal(Origin=facen.Centers, ZAxis=facen.Normals)
vec2pt = Vector2Pt(PointA=facen.Centers, PointB=facen_2.Centers, Unitize=False)  # -> Vector, Length
align = AlignPlane(Plane=pl, Direction=vec2pt.Vector)  # -> flatten(Plane), Angle
bbox = BoundingBox(Content=mesh_2, Plane=graft(align.Plane))  # -> flatten(Box), Box_2
box_corners = BoxCorners(Box=bbox.Box)  # -> CornerA, CornerB, CornerC, CornerD, CornerE, CornerF, CornerG, CornerH
pl_origin = PlaneOrigin(Base=align.Plane, Origin=box_corners.CornerD)
debox = DeconstructBox(Box=bbox.Box)  # -> Plane, X, Y, Z
dedomain = DeconstructDomain(Domain=debox.Y)  # -> Start, End
xy = XYPlane(Origin=Point(0, 0, 0))
rotate = Rotate(Geometry=xy, Angle=1.570796327, Plane=PlaneXY(0, 0, 0))  # -> Geometry, Transform

# ----
subtraction = Subtraction(A=dedomain.End, B=dedomain.Start)

# ---- group: laying out (continued)
ma = MassAddition(Input=subtraction)  # -> Result, PartialResults
X = UnitX(Factor=ma.PartialResults)

# ----
multiplication = Multiplication(A=X, B=B)

# ---- group: laying out (continued)
neg = Negative(Value=multiplication)
move = Move(Geometry=rotate.Geometry, Motion=neg)  # -> Geometry, Transform
pln = Plane(move.Geometry)

# ----
orient = Orient(Geometry=flatten(mesh_2), Source=pl_origin, Target=pln)  # -> Geometry, Transform

# ---- group: Cluster Output
G = ClusterOutput(orient.Geometry)
