# Grasshopper definition 20200117=霄唅又如Upload.gh (Grasshopper 1.0.7)
# plug-ins: MeshEdit Components, Human, Kangaroo Components, Bifocals, Weaverbird, Kangaroo2 Components

mesh = Mesh(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)
clean = CombineClean(Meshes=mesh)
md = MeshDirection(Mesh=clean)
refine = Refine(Mesh=md, Level=Slider(1, range=0..10))
nv = NakedVertices(Mesh=refine)  # -> ClothedIndex, NakedIndex, ClothedPts, NakedPts
edgelengths = EdgeLengths(Mesh=refine, LengthFactor=Slider(0.7, range=0..1), Strength=1)
pt = Point(nv.NakedPts)
show = Show(G=refine)
anchorxyz = AnchorXYZ(Point=nv.NakedPts, X=Toggle(False), Y=Toggle(False), Z=Toggle(True), Strength=1000)
number_slider = Slider(100, range=0..100)

pdecon = Deconstruct(Point=nv.NakedPts)  # -> XComponent, YComponent, ZComponent
# 將錨定點貼到curve（在rh畫的）上
avr = Average(Input=pdecon.XComponent)
avr_2 = Average(Input=pdecon.ZComponent)
avr_3 = Average(Input=pdecon.YComponent)
smaller = SmallerThan(FirstNumber=pdecon.XComponent, SecondNumber=avr)  # -> SmallerThan, OrEqualTo
smaller_2 = SmallerThan(FirstNumber=pdecon.ZComponent, SecondNumber=avr_2)  # -> SmallerThan, OrEqualTo
smaller_3 = SmallerThan(FirstNumber=pdecon.YComponent, SecondNumber=avr_3)  # -> SmallerThan, OrEqualTo
dispatch = Dispatch(List=nv.NakedPts, DispatchPattern=smaller.SmallerThan)  # -> ListA, ListB
dispatch_2 = Dispatch(List=nv.NakedPts, DispatchPattern=smaller_2.SmallerThan)  # -> ListA, ListB
dispatch_3 = Dispatch(List=nv.NakedPts, DispatchPattern=smaller_3.SmallerThan)  # -> ListA, ListB
entwine = Entwine(Branch00=dispatch.ListA, Branch01=dispatch.ListB, FlattenInputs=True)  # -> simplify(Result)
entwine_2 = Entwine(Branch00=dispatch_2.ListA, Branch01=dispatch_2.ListB, FlattenInputs=True)  # -> simplify(Result)
crv = Curve(simplify(graft([<curve referenced from the Rhino model> x2])))
crv_2 = Curve(simplify(graft([<curve referenced from the Rhino model> x2])))
crv_3 = Curve(simplify(graft([<curve referenced from the Rhino model> x2])))
entwine_3 = Entwine(Branch00=dispatch_3.ListA, Branch01=dispatch_3.ListB, FlattenInputs=True)  # -> simplify(Result)
oncurve = OnCurve(Points=entwine, Curve=crv, Strength=1)
oncurve_2 = OnCurve(Points=entwine_2, Curve=crv_2, Strength=1)
oncurve_3 = OnCurve(Points=entwine_3, Curve=crv_3, Strength=1)

pt_2 = Point([Point(-2, 16, 20), Point(-3.25, 16, 20), Point(-4.5, 16, 20), Point(-5.75, 16, 20), Point(-7, 16, 20), Point(-8.25, 16, 20), Point(-9.5, 16, 20), Point(-10.75, 16, 20), Point(-12, 16, 20), Point(-12, 14.75, 20), Point(-12, 13.5, 20), Point(-12, 12.25, 20), Point(-12, 11, 20), Point(-12, 9.75, 20), Point(-12, 8.5, 20), Point(-12, 7.25, 20), Point(-12, 6, 20), Point(-12, 4.75, 20), Point(-12, 3.5, 20), Point(-12, 2.25, 20), Point(-12, 1, 20), Point(-12, -0.25, 20), Point(-12, -1.5, 20), Point(-12, -2.75, 20), Point(-12, -4, 20)])
brep = Brep(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)
pt_3 = Point([Point(-12, -4, 18.75), Point(-12, -4, 17.5), Point(-12, -4, 16.25), Point(-12, -4, 15), Point(-12, -4, 13.75), Point(-12, -4, 12.5), Point(-12, -4, 11.25), Point(-12, -4, 10)])
brep_2 = Brep(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)
pt_4 = Point([Point(8, 16, 20), Point(8, 16, 18.75), Point(8, 16, 17.5), Point(8, 16, 16.25), Point(8, 16, 15), Point(8, 16, 13.75), Point(8, 16, 12.5), Point(8, 16, 11.25), Point(8, 16, 10), Point(8, 14.75, 20)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])
brep_3 = Brep(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)
pt_5 = Point([Point(8, 16, 0), Point(8, 14.75, 0), Point(8, 13.5, 0), Point(8, 12.25, 0), Point(8, 11, 0), Point(8, 9.75, 0)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])
brep_4 = Brep(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)
pt_6 = Point([Point(8, -4, 10), Point(8, -4, 8.75), Point(8, -4, 7.5), Point(8, -4, 6.25), Point(8, -4, 5), Point(8, -4, 3.75), Point(8, -4, 2.5), Point(8, -4, 1.25), Point(8, -4, 0), Point(6.75, -4, 0), Point(5.5, -4, 0), Point(4.25, -4, 0), Point(3, -4, 0), Point(1.75, -4, 0), Point(0.5, -4, 0), Point(-0.75, -4, 0), Point(-2, -4, 0), Point(-3.25, -4, 0), Point(-4.5, -4, 0), Point(-5.75, -4, 0), Point(-7, -4, 0), Point(-8.25, -4, 0), Point(-9.5, -4, 0), Point(-10.75, -4, 0), Point(-12, -4, 0)])
# 將錨定點貼到Brep（在rh畫的sphere）上
brep_5 = Brep(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)
brep_cp = BrepClosestPoint(Point=pt_2, Brep=brep)  # -> Point, Normal, Distance
brep_cp_2 = BrepClosestPoint(Point=pt_3, Brep=brep_2)  # -> Point, Normal, Distance
brep_cp_3 = BrepClosestPoint(Point=pt_4, Brep=brep_3)  # -> Point, Normal, Distance
brep_cp_4 = BrepClosestPoint(Point=pt_5, Brep=brep_4)  # -> Point, Normal, Distance
brep_cp_5 = BrepClosestPoint(Point=pt_6, Brep=brep_5)  # -> Point, Normal, Distance
anchor = Anchor(Point=pt_2, Target=brep_cp.Point, Strength=number_slider)
anchor_2 = Anchor(Point=pt_3, Target=brep_cp_2.Point, Strength=number_slider)
anchor_3 = Anchor(Point=pt_4, Target=brep_cp_3.Point, Strength=10000)
anchor_4 = Anchor(Point=pt_5, Target=brep_cp_4.Point, Strength=number_slider)
anchor_5 = Anchor(Point=pt_6, Target=brep_cp_5.Point, Strength=number_slider)
anchor_6 = Anchor(Point=nv.NakedPts, Strength=10000)
entwine_4 = Entwine(
    Branch00=show,
    Branch02=edgelengths,
    Branch03=anchor,
    Branch04=anchor_2,
    Branch05=anchor_3,
    Branch06=anchor_5,
    Branch07=anchor_4,
    FlattenInputs=True)
solver = Solver(GoalObjects=entwine_4, Reset=Button(), Threshold=1e-15, Tolerance=0.01, On=Toggle(True))  # -> I, V, O
bang = ExplodeTree(Data=solver.O)  # -> Branch0, Branch1, Branch2
mesh_2 = Mesh(bang.Branch0)

# ----
# 找最大的邊
# 限制在 60 以內
# 其他邊等比例縮放
limit = Slider(55, range=0..100)

bbox = BoundingBox(Content=mesh_2, Plane=PlaneXY(0, 0, 0))  # -> Box, Box_2
boxprop = BoxProperties(Box=bbox.Box)  # -> Center, Diagonal, Area, Volume, Degeneracy
pdecon_2 = Deconstruct(Point=boxprop.Diagonal)  # -> XComponent, YComponent, ZComponent
max = Maximum(A=pdecon_2.XComponent, B=pdecon_2.YComponent)
max_2 = Maximum(A=max, B=pdecon_2.ZComponent)
division = Division(A=limit, B=max_2)

scale = Scale(Geometry=mesh_2, Center=boxprop.Center, Factor=division)  # -> Geometry, Transform
material = CreateMaterial(
    Diffuse=RGB(255, 105, 180),
    Specular=RGB(255, 255, 255),
    Emission=RGB(0, 0, 0),
    Transparency=Slider(0.7, range=0..1),
    Shine=0)
preview = CustomPreview(Geometry=scale.Geometry, Material=material)
stripper = Stripper(Mesh=scale.Geometry)

# ----
# 各物件assign物件名
panel = Panel("s_")
concat = Concatenate(FragmentA=panel)
mesh_3 = Mesh(simplify(graft(stripper)))
createatts = CreateAttributes(Name=concat, enableFullPath=True)
bake = BakeGeometry(Bake=Button(), Geometry=mesh_3, Attributes=createatts, DeleteOldBakes=False, PreserveTrees=False)

unroller = Unroller(Strip=stripper, Unroll=Slider(1, range=0..1))

explode = MeshExplode(Mesh=stripper, Interpolate=False)  # -> simplify(Faces)
tstat = TreeStatistics(Tree=explode)  # -> Paths, Length, Count
item = ListItem(List=explode, Index=0, Wrap=True)  # -> Item1, Item
series = Series(Start=0, Step=1, Count=tstat.Count)  # -> simplify(graft(Series))
facen = FaceNormals(Mesh=item.Item)  # -> Centers, Normals
gradient = Gradient(
    LowerLimit=0,
    UpperLimit=tstat.Count,
    Parameter=series,
    stops=[0.108: RGB(255, 0, 255), 0.535: RGB(255, 255, 0), 0.945: RGB(0, 255, 255)])
tag = TextTag3D(Location=facen.Centers, Text=series, Size=Slider(1.5, range=0..10), Colour=gradient, Justification=7)

wbnaked = WeaverbirdsNakedBoundary(MeshClosedPolylines=stripper)
wbnaked_2 = WeaverbirdsNakedBoundary(MeshClosedPolylines=scale.Geometry)
cluster = Cluster(B=Slider(1.7, range=0..10), mesh=unroller)

explode_2 = MeshExplode(Mesh=cluster, Interpolate=False)  # -> simplify(Faces)
item_2 = ListItem(List=explode_2, Index=0, Wrap=True)  # -> Item1, Item
facen_2 = FaceNormals(Mesh=item_2.Item)  # -> Centers, Normals
tag_2 = TextTag(Location=facen_2.Centers, Text=series, Colour=gradient)

explode_3 = Explode(Curve=wbnaked, Recursive=True)  # -> simplify(Segments), Vertices
curvepoint = PointOnCurve(explode_3.Segments, parameter=0.5)
wbnaked_3 = WeaverbirdsNakedBoundary(MeshClosedPolylines=cluster)
explode_4 = Explode(Curve=wbnaked_3, Recursive=True)  # -> simplify(Segments), Vertices
colom = CollisionOneMany(Collider=curvepoint, Obstacles=wbnaked_2)  # -> Collision, Index
dispatch_4 = Dispatch(List=explode_4.Segments, DispatchPattern=invert(colom.Collision))  # -> ListA, ListB
cull = CullPattern(List=explode_3.Segments, CullPattern=invert(colom.Collision))

# ---- group: TabCrv
crv_4 = Curve(graft([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]))
crv_5 = Curve(graft([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]))

# ----
bbox_2 = BoundingBox(Content=wbnaked_3, Plane=PlaneXY(0, 0, 0))  # -> Box, Box_2

concat_2 = Concatenate(FragmentA="s_", FragmentB=series)
createatts_2 = CreateAttributes(Name=concat_2, enableFullPath=True)
bake_2 = BakeGeometry(Bake=Button(), Geometry=graft(stripper), Attributes=createatts_2, DeleteOldBakes=False, PreserveTrees=False)

crv_6 = Curve(graft([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]))
wires = BrepWireframe(Brep=bbox_2.Box, Density=-1)
crv_7 = Curve(dispatch_4.ListA)
bbox_3 = BoundingBox(Content=crv_6, Plane=PlaneXY(0, 0, 0))  # -> Box, Box_2
linedim = LineDimension(Line=wires, Text="{0:0.00}", Size=Slider(2, range=0..10))
debox = DeconstructBox(Box=bbox_3.Box)  # -> Plane, X, Y, Z
numstab = Slider(1, range=1..4)
dedomain = DeconstructDomain(Domain=debox.X)  # -> Start, End
subtraction = Subtraction(A=dedomain.End, B=dedomain.Start)
series_2 = Series(Start=0, Step=subtraction, Count=numstab)
X = UnitX(Factor=series_2)
move = Move(Geometry=simplify(crv_6), Motion=simplify(X))  # -> Geometry, Transform
join = JoinCurves(Curves=move.Geometry, Preserve=False)  # -> simplify(Curves)
end = EndPoints(Curve=join)  # -> Start, End
depthtab = Slider(1, range=0.1..1)
dist = Distance(PointA=end.Start, PointB=end.End)
entwine_5 = Entwine(Branch00=crv_7, Branch01=crv_7, FlattenInputs=True)  # -> simplify(Result)
multiplication = Multiplication(A=dist, B=depthtab)
len = Length(Curve=entwine_5)  # -> simplify(Length)
division_2 = Division(A=len, B=multiplication)
scale_nu = ScaleNU(Geometry=join, Plane=PlaneXY(0, 0, 0), ScaleX=division_2, ScaleY=1, ScaleZ=1)  # -> Geometry, Transform
bang_2 = ExplodeTree(Data=scale_nu.Geometry)  # -> Branch0, Branch1
unflatten = UnflattenTree(Tree=bang_2.Branch1, Guide=crv_7)  # -> simplify(Tree)
unflatten_2 = UnflattenTree(Tree=bang_2.Branch0, Guide=crv_7)  # -> simplify(Tree)
end_2 = EndPoints(Curve=crv_7)  # -> Start, End
end_3 = EndPoints(Curve=unflatten_2)  # -> Start, End
end_4 = EndPoints(Curve=unflatten)  # -> Start, End
end_5 = EndPoints(Curve=crv_7)  # -> Start, End
offset = OffsetCurve(Curve=crv_7, Distance="-0.5", Plane=PlaneXY(0, 0, 0), Corners=1)

# ---- group: label of 2d stripe
mesh_4 = Mesh(flatten(cluster))
explode_5 = MeshExplode(Mesh=mesh_4, Interpolate=False)  # -> simplify(Faces)
lng = ListLength(List=mesh_4)
series_3 = Series(Start=0, Step=1, Count=lng)  # -> graft(Series)
repeat = RepeatData(Data="s_", Length=lng)  # -> graft(Data)
item_3 = ListItem(List=explode_5, Index=0, Wrap=True)  # -> Item1, Item
bbox_4 = BoundingBox(Content=item_3.Item, Plane=PlaneXY(0, 0, 0))  # -> Box, Box_2
join_2 = TextJoin(Text=[repeat, series_3])

# ----
vec2pt = Vector2Pt(PointA=end_3.Start, PointB=end_3.End, Unitize=False)  # -> Vector, Length
vec2pt_2 = Vector2Pt(PointA=end_2.Start, PointB=end_2.End, Unitize=False)  # -> Vector, Length
vec2pt_3 = Vector2Pt(PointA=end_4.Start, PointB=end_4.End, Unitize=False)  # -> Vector, Length
vec2pt_4 = Vector2Pt(PointA=end_5.End, PointB=end_5.Start, Unitize=False)  # -> Vector, Length
orient = OrientDirection(Geometry=unflatten, PointA=end_4.Start, DirectionA=vec2pt_3.Vector, PointB=end_5.End, DirectionB=vec2pt_4.Vector)  # -> Geometry, Transform
orient_2 = OrientDirection(Geometry=unflatten_2, PointA=end_3.Start, DirectionA=vec2pt.Vector, PointB=end_2.Start, DirectionB=vec2pt_2.Vector)  # -> Geometry, Transform
eval = EvaluateCurve(Curve=reparameterize(offset), Parameter="0.3")  # -> simplify(Point), Tangent, Angle
eval_2 = EvaluateCurve(Curve=reparameterize(offset), Parameter=expr("1-x", "0.3"))  # -> simplify(Point), Tangent, Angle
eval_3 = EvaluateCurve(Curve=reparameterize(offset), Parameter="0.2")  # -> simplify(Point), Tangent, Angle
eval_4 = EvaluateCurve(Curve=reparameterize(offset), Parameter=expr("1-x", "0.2"))  # -> simplify(Point), Tangent, Angle
dispatch_5 = Dispatch(List=orient.Geometry, DispatchPattern=[True, False])  # -> ListA, ListB
dispatch_6 = Dispatch(List=orient_2.Geometry, DispatchPattern=[True, False])  # -> ListA, ListB
weave = Weave(Pattern=[0, 1], Stream0=dispatch_6.ListA, Stream1=dispatch_5.ListB, NullGaps=False)
dom = ConstructDomain(DomainStart=expr("-x", "0.125"), DomainEnd="0.125")
dom_2 = ConstructDomain(DomainStart=expr("-x", "0.125"), DomainEnd="0.125")
geo = Geometry(dispatch_6.ListA)
pl = ConstructPlane(Origin=eval.Point, XAxis=eval.Tangent, YAxis=Vector(0, 1, 0))
pl_2 = ConstructPlane(Origin=eval_2.Point, XAxis=eval_2.Tangent, YAxis=Vector(0, 1, 0))
pl_3 = ConstructPlane(Origin=eval_3.Point, XAxis=eval_3.Tangent, YAxis=Vector(0, 1, 0))
pl_4 = ConstructPlane(Origin=eval_4.Point, XAxis=eval_4.Tangent, YAxis=Vector(0, 1, 0))
geo_2 = Geometry(dispatch_5.ListA)
join_3 = JoinCurves(Curves=weave, Preserve=False)

# ---- group: clip
panel_2 = Panel("0.002")
panel_3 = Panel("0.8")

# ----
box = EvaluateBox(Box=bbox_4.Box, UParameter=0.5, VParameter=0.5, WParameter=0.5)  # -> Plane, Point, Include
# Bake!!!!
merge = Merge(Data1=simplify(join_3), Data2=simplify(dispatch_4.ListB))
rectangle = Rectangle(Plane=pl, XSize=dom_2, YSize=dom, Radius=0)  # -> Rectangle, Length
rectangle_2 = Rectangle(Plane=pl_2, XSize=dom_2, YSize=dom, Radius=0)  # -> Rectangle, Length
rectangle_3 = Rectangle(Plane=pl_3, XSize=dom_2, YSize=dom, Radius=0)  # -> Rectangle, Length
rectangle_4 = Rectangle(Plane=pl_4, XSize=dom_2, YSize=dom, Radius=0)  # -> Rectangle, Length
tag_3 = TextTag(Location=box.Plane, Text=join_2)
crease = Curve(simplify(crv_7))
cut = Curve(merge)
merge_2 = Merge(Data1=rectangle.Rectangle, Data2=rectangle_2.Rectangle, Data3=rectangle_3.Rectangle, Data4=rectangle_4.Rectangle)
preview_2 = CustomPreview(Geometry=crease, Material=ColourSwatch(SwatchColor=RGB(0, 0, 0)))
preview_3 = CustomPreview(
    Geometry=cut,
    Material={diffuse=RGB(221, 160, 221), emission=RGB(66, 48, 66), shine=0.5, specular=RGB(255, 255, 255), transparency=0})
pshift = ShiftPaths(Data=merge_2, Offset=-1)

# ==== cluster Cluster

# ---- group: Cluster Input
mesh = ClusterInput()

# ----
mesh_2 = Mesh(graft(mesh))
B = ClusterInput()

# ---- group: laying out
explode = MeshExplode(Mesh=mesh_2, Interpolate=False)
item = ListItem(List=explode, Index=0, Wrap=True)
item_2 = ListItem(List=explode, Index=-1, Wrap=True)
facen = FaceNormals(Mesh=item)  # -> Centers, Normals
facen_2 = FaceNormals(Mesh=item_2)  # -> Centers, Normals
pl = PlaneNormal(Origin=facen.Centers, ZAxis=facen.Normals)
vec2pt = Vector2Pt(PointA=facen.Centers, PointB=facen_2.Centers, Unitize=False)  # -> Vector, Length
align = AlignPlane(Plane=pl, Direction=vec2pt.Vector)  # -> flatten(Plane), Angle
bbox = BoundingBox(Content=mesh_2, Plane=graft(align.Plane))  # -> flatten(Box), Box_2
box_corners = BoxCorners(Box=bbox.Box)  # -> CornerA, CornerB, CornerC, CornerD, CornerE, CornerF, CornerG, CornerH
pl_origin = PlaneOrigin(Base=align.Plane, Origin=box_corners.CornerD)
debox = DeconstructBox(Box=bbox.Box)  # -> Plane, X, Y, Z
dedomain = DeconstructDomain(Domain=debox.Y)  # -> Start, End
xy = XYPlane(Origin=Point(0, 0, 0))
rotate = Rotate(Geometry=xy, Angle=1.570796327, Plane=PlaneXY(0, 0, 0))  # -> Geometry, Transform

# ----
subtraction = Subtraction(A=dedomain.End, B=dedomain.Start)

# ---- group: laying out (continued)
ma = MassAddition(Input=subtraction)  # -> Result, PartialResults
X = UnitX(Factor=ma.PartialResults)

# ----
multiplication = Multiplication(A=X, B=B)

# ---- group: laying out (continued)
neg = Negative(Value=multiplication)
move = Move(Geometry=rotate.Geometry, Motion=neg)  # -> Geometry, Transform
pln = Plane(move.Geometry)

# ----
orient = Orient(Geometry=flatten(mesh_2), Source=pl_origin, Target=pln)  # -> Geometry, Transform

# ---- group: Cluster Output
G = ClusterOutput(orient.Geometry)
